# Grasshopper definition E_21 Landscape With Random Vegetation.gh (Grasshopper 1.0.7)
# plug-ins: Bifocals

count = Slider(788, range=0..1000)
count_2 = Slider(42, range=0..1000)
surface = Surface(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)
curve = Curve([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])
point = Point(Point(0, 0, 0))

addition = Addition(A=count_2, B="1")
random = Random(Range=Domain(0, 1), Number=count, Seed=count_2)
random_2 = Random(Range=Domain(0, 1), Number=count, Seed=addition)
panel = Panel(curve)
construct_point = ConstructPoint(XCoordinate=random, YCoordinate=random_2, ZCoordinate=0)
evaluate_surface = EvaluateSurface(Surface=reparameterize(surface), Point=construct_point)  # -> Point, Normal, UDirection, VDirection, Frame
deconstruct_plane = DeconstructPlane(Plane=evaluate_surface.Point)  # -> Origin, XAxis, YAxis, ZAxis
xy_plane = XYPlane(Origin=deconstruct_plane.Origin)

construct_domain = ConstructDomain(DomainStart="0", DomainEnd="2 * Pi")
random_3 = Random(Range=construct_domain, Number=count, Seed=2)
rotate = Rotate(Geometry=xy_plane, Angle=random_3, Plane=xy_plane)  # -> Geometry, Transform

panel_2 = Panel(random_3)
xy_plane_2 = XYPlane(Origin=point)
graft_tree = GraftTree(Tree=rotate.Geometry, IncludeEmptyLists=True, IncludeNullItems=True)
orient = Orient(Geometry=curve, Source=xy_plane_2, Target=graft_tree)  # -> Geometry, Transform

# ---- group: scaling
maximum = Slider(1.8, range=0.8..3)
minmum = Slider(0.8, range=0.8..2)
construct_domain_2 = ConstructDomain(DomainStart=minmum, DomainEnd=maximum)
scale = Scale(Geometry=orient.Geometry, Center=graft_tree, Factor=construct_domain_2)  # -> Geometry, Transform

# ----
panel_3 = Panel(graft_tree)
