# Grasshopper definition E_22 Wind-swept Grass Patch.gh (Grasshopper 1.0.7)
# plug-ins: Bifocals

construct_point = ConstructPoint(XCoordinate=Slider(1, range=1..1000), YCoordinate=Slider(1, range=1..1000), ZCoordinate=Slider(110, range=1..1000))

time = Slider(0, range=0..100)

root_tangency = Slider(50, range=0..100)
grass_base_height = Slider(9, range=0..18)
grass_random_variation = Slider(3, range=0..10)
count = Slider(1000, range=1..1000)
randomseed = Slider(42, range=0..1000)
surface = Surface(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)

random = Random(Range=Domain(0, 1), Number=count, Seed=randomseed)
negative = Negative(Value=grass_random_variation)
addition = Addition(A=randomseed, B="1")
random_2 = Random(Range=Domain(0, 1), Number=count, Seed=addition)
construct_point_2 = ConstructPoint(XCoordinate=random, YCoordinate=random_2, ZCoordinate=0)
construct_domain = ConstructDomain(DomainStart=negative, DomainEnd=grass_random_variation)
evaluate_surface = EvaluateSurface(Surface=reparameterize(surface), Point=construct_point_2)  # -> Point, Normal, UDirection, VDirection, Frame
random_3 = Random(Range=construct_domain, Number=count, Seed=2)
subtraction = Subtraction(A=grass_base_height, B=grass_random_variation)
addition_2 = Addition(A=subtraction, B=random_3)
deconstruct_plane = DeconstructPlane(Plane=evaluate_surface.Frame)  # -> Origin, XAxis, YAxis, ZAxis
multiplication = Multiplication(A=deconstruct_plane.ZAxis, B=root_tangency)
unit_z = UnitZ(Factor=addition_2)
move = Move(Geometry=deconstruct_plane.Origin, Motion=multiplication)  # -> Geometry, Transform
vector_2pt = Vector2Pt(PointA=construct_point, PointB=move.Geometry, Unitize=False)  # -> Vector, Length
addition_3 = Addition(A=vector_2pt.Length, B=time)
sine = Sine(Value=addition_3)
vector_display = VectorDisplay(Anchor=construct_point, Vector=vector_2pt.Vector)
vector_display_2 = VectorDisplay(Anchor=deconstruct_plane.Origin, Vector=multiplication)
move_2 = Move(Geometry=move.Geometry, Motion=unit_z)  # -> Geometry, Transform
multiplication_2 = Multiplication(A=sine, B="6")
unit_y = UnitY(Factor=multiplication_2)
move_3 = Move(Geometry=move_2.Geometry, Motion=unit_y)  # -> Geometry, Transform
graft_tree = GraftTree(Tree=deconstruct_plane.Origin, IncludeEmptyLists=True, IncludeNullItems=True)
graft_tree_2 = GraftTree(Tree=move.Geometry, IncludeEmptyLists=True, IncludeNullItems=True)
graft_tree_3 = GraftTree(Tree=move_3.Geometry, IncludeEmptyLists=True, IncludeNullItems=True)
panel = Panel([graft_tree_2, graft_tree, graft_tree_3])
interpolate = Interpolate(Vertices=[graft_tree, graft_tree_2, graft_tree_3], Degree=3, Periodic=False, KnotStyle=1)  # -> Curve, Length, Domain
