# Grasshopper definition E_24 Exploding Brick Wall.gh (Grasshopper 1.0.7)
# plug-ins: Bifocals

grid_thk = Slider(2, range=0..10)

nh = Slider(12, range=0..200)
nv = Slider(19, range=0..200)
w = Slider(80, range=0..100)
d = Slider(40, range=0..100)
h = Slider(20, range=0..100)

point = Point(Point(0, 0, 0))
xy_plane = XYPlane(Origin=point)

expression = Expression(w=w, nh=nh, Expression="w * (nh - 0.5)")
expression_2 = Expression(x=nv, Expression="Floor(x * 0.5)")
expression_3 = Expression(x=h, Expression="x * (-1)")
expression_4 = Expression(x=h, Expression="x * 2")
construct_point = ConstructPoint(XCoordinate=expression_3, YCoordinate=0, ZCoordinate=h)
series = Series(Start=0, Step=expression_4, Count=expression_2)
series_2 = Series(Start=0, Step=expression, Count="2")
move = Move(Geometry=xy_plane, Motion=construct_point)  # -> Geometry, Transform
unit_x = UnitX(Factor=series_2)
unit_z = UnitZ(Factor=series)
move_2 = Move(Geometry=move.Geometry, Motion=unit_x)  # -> Geometry, Transform
graft_tree = GraftTree(Tree=unit_z, IncludeEmptyLists=True, IncludeNullItems=True)
move_3 = Move(Geometry=move_2.Geometry, Motion=graft_tree)  # -> Geometry, Transform

expression_5 = Expression(x=nv, Expression="Floor(x * 0.5)")
expression_6 = Expression(x=w, Expression="0.5 * x")
expression_7 = Expression(x=nh, Expression="x - 1")
expression_8 = Expression(x=h, Expression="x * 2")
construct_point_2 = ConstructPoint(XCoordinate=expression_6, YCoordinate=0, ZCoordinate=h)
series_3 = Series(Start=0, Step=w, Count=expression_7)
series_4 = Series(Start=0, Step=expression_8, Count=expression_5)
move_4 = Move(Geometry=xy_plane, Motion=construct_point_2)  # -> Geometry, Transform
unit_x_2 = UnitX(Factor=series_3)
unit_z_2 = UnitZ(Factor=series_4)
move_5 = Move(Geometry=move_4.Geometry, Motion=unit_x_2)  # -> Geometry, Transform
graft_tree_2 = GraftTree(Tree=unit_z_2, IncludeEmptyLists=True, IncludeNullItems=True)
move_6 = Move(Geometry=move_5.Geometry, Motion=graft_tree_2)  # -> Geometry, Transform

expression_9 = Expression(x=nv, Expression="x * 0.5")
expression_10 = Expression(x=h, Expression="x * 2")
series_5 = Series(Start=0, Step=w, Count=nh)
series_6 = Series(Start=0, Step=expression_10, Count=expression_9)
unit_x_3 = UnitX(Factor=series_5)
unit_z_3 = UnitZ(Factor=series_6)
move_7 = Move(Geometry=xy_plane, Motion=unit_x_3)  # -> Geometry, Transform
graft_tree_3 = GraftTree(Tree=unit_z_3, IncludeEmptyLists=True, IncludeNullItems=True)
move_8 = Move(Geometry=move_7.Geometry, Motion=graft_tree_3)  # -> Geometry, Transform

x = Slider(321, range=0..1000)
z = Slider(39, range=0..1000)
y = Slider(194, range=0..1000)

base_bricks_planes = Plane(move_6.Geometry)
edge_bricks_planes = Plane(move_3.Geometry)
base_bricks_planes_2 = Plane(move_8.Geometry)
plane = Plane(flatten([base_bricks_planes_2, base_bricks_planes]))
plane_2 = Plane(flatten(edge_bricks_planes))

construct_point_3 = ConstructPoint(XCoordinate=x, YCoordinate=y, ZCoordinate=z)
time = Slider(0, range=0..4)
vector_2pt = Vector2Pt(PointA=construct_point_3, PointB=plane, Unitize=False)  # -> Vector, Length
vector_2pt_2 = Vector2Pt(PointA=construct_point_3, PointB=plane_2, Unitize=False)  # -> Vector, Length
expression_11 = Expression(x=vector_2pt.Length, Expression="60000 / x")
expression_12 = Expression(x=vector_2pt_2.Length, Expression="60000 / x")
multiplication = Multiplication(A=time, B=expression_11)
multiplication_2 = Multiplication(A=time, B=expression_12)
amplitude = Amplitude(Vector=vector_2pt.Vector, Amplitude=multiplication)
amplitude_2 = Amplitude(Vector=vector_2pt_2.Vector, Amplitude=multiplication_2)
move_9 = Move(Geometry=plane, Motion=amplitude)  # -> Geometry, Transform
move_10 = Move(Geometry=plane_2, Motion=amplitude_2)  # -> Geometry, Transform
x_2 = Slider(42, range=0..100)
x_3 = Slider(42, range=0..100)
list_length = ListLength(List=move_10.Geometry)
list_length_2 = ListLength(List=move_9.Geometry)
expression_13 = Expression(x=x_2, Expression="x + 1")
expression_14 = Expression(x=x_2, Expression="x + 2")
expression_15 = Expression(x=x_3, Expression="x + 1")
expression_16 = Expression(x=x_3, Expression="x + 2")
random = Random(Range="-1 To 1", Number=list_length, Seed=x_2)
random_2 = Random(Range="-1 To 1", Number=list_length, Seed=expression_13)
random_3 = Random(Range="-1 To 1", Number=list_length, Seed=expression_14)
random_4 = Random(Range="-1 To 1", Number=list_length_2, Seed=x_3)
random_5 = Random(Range="-1 To 1", Number=list_length_2, Seed=expression_15)
random_6 = Random(Range="-1 To 1", Number=list_length_2, Seed=expression_16)
deconstruct_plane = DeconstructPlane(Plane=move_9.Geometry)  # -> Origin, XAxis, YAxis, ZAxis
deconstruct_plane_2 = DeconstructPlane(Plane=move_10.Geometry)  # -> Origin, XAxis, YAxis, ZAxis
vector_xyz = VectorXYZ(XComponent=random, YComponent=random_2, ZComponent=random_3)  # -> Vector, Length
vector_xyz_2 = VectorXYZ(XComponent=random_4, YComponent=random_5, ZComponent=random_6)  # -> Vector, Length
rotate_3d = Rotate3D(Geometry=move_9.Geometry, Angle=time, Center=deconstruct_plane.Origin, Axis=vector_xyz_2.Vector)  # -> Geometry, Transform

expression_17 = Expression(x=w, y=grid_thk, Expression="(x - y) / 2")
expression_18 = Expression(x=d, y=grid_thk, Expression="(x - y) / 2")
expression_19 = Expression(x=h, y=grid_thk, Expression="(x - y) / 2")
center_box = CenterBox(Base=rotate_3d.Geometry, X=expression_17, Y=expression_18, Z=expression_19)

rotate_3d_2 = Rotate3D(Geometry=move_10.Geometry, Angle=time, Center=deconstruct_plane_2.Origin, Axis=vector_xyz.Vector)  # -> Geometry, Transform

expression_20 = Expression(x=w, y=grid_thk, Expression="(x - 2 * y) / 4")
expression_21 = Expression(x=d, y=grid_thk, Expression="(x - y) / 2")
expression_22 = Expression(x=h, y=grid_thk, Expression="(x - y) / 2")
center_box_2 = CenterBox(Base=rotate_3d_2.Geometry, X=expression_20, Y=expression_21, Z=expression_22)
